# Grasshopper definition parametric_script_library_v0.0.gh (Grasshopper 1.0.8)

srf = Surface([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])
pt = Point(Point(128, 60, 40))
pulllayergeo = PullLayerGeometry(layer_name="Default", pull=Toggle(True))  # -> geo; inputs layer_name: String, pull: Boolean
# ---------- pulllayergeo: Python ----------
"""
Pulls geometry from a specified Rhino layer or sublayer.

Inputs:
    layer_name: Text (item access, str)
    pull: Boolean (item access, bool)

Outputs:
    geo: List of Geometry (The geometry pulled from the specified layer)
"""

try:
    ghenv.Component.Name = "PullLayerGeometry"
    ghenv.Component.NickName = "PullLayerGeo"
    ghenv.Component.Description = "Pulls geometry from a specified Rhino layer or sublayer."
except NameError:
    pass

import Rhino

geo = []

if pull and layer_name:
    doc = Rhino.RhinoDoc.ActiveDoc
    
    # Locate the layer by its full path name (supports "layer::sublayer" formatting)
    layer_index = doc.Layers.FindByFullPath(layer_name, -1)
    
    if layer_index >= 0:
        # Layer exists, retrieve all objects on this specific layer
        rhino_objects = doc.Objects.FindByLayer(layer_name)
        
        if rhino_objects:
            for obj in rhino_objects:
                # Extract and append the base RhinoCommon geometry of each object
                geo.append(obj.Geometry)
    else:
        print("Warning: Layer '{}' was not found in the active document.".format(layer_name))
# ---------- end pulllayergeo ----------
bakegeo = BakeGeometry(geo=srf, layer_name="test layer::test sub3", layer_color=pt, replace=Slider(1, range=0..1), bake=Button())  # inputs geo: list of GeometryBase, layer_name: String, layer_color: Point3d, replace: Boolean, bake: Boolean
# ---------- bakegeo: Python ----------
"""
Bakes input geometry to a specified layer in Rhino, with options to add or replace existing layer contents.

Inputs:
    geo: Geometry (list access, geometry)
    layer_name: Text (item access, string)
    layer_color: Point3d (item access, Point3d) - X,Y,Z maps to R,G,B (0-255)
    replace: Boolean (item access, bool)
    bake: Boolean (item access, bool)

Outputs:
    (None)
"""

try:
    ghenv.Component.Name = "BakeGeometry"
    ghenv.Component.NickName = "BakeGeo"
    ghenv.Component.Description = "Bakes input geometry to a specified layer in Rhino, with options to add or replace existing layer contents."
except NameError:
    pass

import rhinoscriptsyntax as rs
import scriptcontext as sc
import Rhino

def bake_geometry_to_layer():
    # Only execute if the bake toggle is True, and we have valid inputs
    if not bake or not geo or not layer_name:
        return

    # Switch scriptcontext to target the active Rhino Document
    sc.doc = Rhino.RhinoDoc.ActiveDoc
    
    try:
        # Check if the layer exists; if not, create it. 
        # rs.AddLayer inherently supports "Parent::Child" syntax
        if not rs.IsLayer(layer_name):
            rs.AddLayer(layer_name)
            
        # If a color is provided, convert X,Y,Z to R,G,B and apply it
        if layer_color is not None:
            # Extract and clamp values between 0 and 255 to prevent errors
            r = max(0, min(255, int(layer_color.X)))
            g = max(0, min(255, int(layer_color.Y)))
            b = max(0, min(255, int(layer_color.Z)))
            rs.LayerColor(layer_name, (r, g, b))
            
        # If replace mode is True (1 = replace)
        if replace:
            existing_objs = rs.ObjectsByLayer(layer_name)
            if existing_objs:
                rs.DeleteObjects(existing_objs)
                
        # Get the layer index to assign to the new geometry attributes
        # FindByFullPath returns the integer index of the layer directly
        layer_index = sc.doc.Layers.FindByFullPath(layer_name, -1)
        
        # Define Rhino object attributes and assign the target layer index
        attr = Rhino.DocObjects.ObjectAttributes()
        attr.LayerIndex = layer_index
        
        # Iterate through the geometry list and add them to the Rhino document
        for item in geo:
            if item:
                sc.doc.Objects.Add(item, attr)
                
        # Redraw the Rhino viewports so baked objects appear instantly
        sc.doc.Views.Redraw()
        
    finally:
        # Crucial step: Always switch scriptcontext back to Grasshopper
        # Put in a finally block to ensure it happens even if an error occurs above
        sc.doc = ghdoc

# Run the function
bake_geometry_to_layer()
# ---------- end bakegeo ----------
geo = Geometry(pulllayergeo)

press_to_save_userobject = Button()
panel = Panel("*/sample/csv/file/path.csv")
directory_path = Panel("C:\Users\fharker\Documents\GitHub-Local\parametric-sandbox\2_grasshopper_scripts")
press_to_update_gh_def = Button()
press_to_export_csv = Button()
dirfile = DirectoryFile(directory=directory_path)  # -> file_name
# ---------- dirfile: Python ----------
"""
Lists files in a directory.

Inputs:
    directory: String (item access, str)

Outputs:
    file_name: List of Strings (The names of the files in the directory)
"""

try:
    ghenv.Component.Name = "DirectoryFile"
    ghenv.Component.NickName = "DirFile"
    ghenv.Component.Description = "Lists files in a directory."
except NameError:
    pass

import os

if 'directory' in globals() and directory:
    file_name = os.listdir(directory)
else:
    file_name = []
# ---------- end dirfile ----------
genuserobj = GenerateUserObj(
    target_nick="ExistClustNick",
    obj_name="ClusterName",
    obj_desc="Describe the logic of the cluster here",
    category="Category Name",
    sub_category="Section Name",
    icon_path="Optional path for UserObj. icon",
    run=press_to_save_userobject)  # -> user_object; inputs target_nick: String, obj_name: String, obj_desc: String, category: String, icon_path: String, run: Boolean
# ---------- genuserobj: Python ----------
"""
Programmatically packages a specified Grasshopper component into a custom User Object.

Inputs:
    target_nick: String (The nickname of the canvas node/cluster to package)
    obj_name: String (Display name of the new User Object)
    obj_desc: String (Tooltip description for the new User Object)
    category: String (Ribbon Tab name, e.g., "User")
    sub_category: String (Panel section name within the tab)
    icon_path: String (File path to a .png or bitmap image for the node icon)
    run: Boolean (Set to True to execute the creation)

Outputs:
    UserObject: String (Status message indicating success or failure)
"""

try:
    ghenv.Component.Name = "GenerateUserObj"
    ghenv.Component.NickName = "GenUserObj"
    ghenv.Component.Description = "Programmatically packages a specified Grasshopper component into a custom UserObject."
except NameError:
    pass

import Grasshopper as gh
import System.Drawing as drawing
import os

def build_user_object(target_nick, name, desc, category, sub_category, icon_path, run):
    if not run:
        return "Set 'run' to True to create User Object."

    # 1. Locate the target component on the active document
    gh_doc = ghenv.Component.OnPingDocument()
    source_obj = None
    
    for obj in gh_doc.Objects:
        if obj.NickName == target_nick:
            source_obj = obj
            break

    if source_obj is None:
        return "Error: Component with nickname '{}' not found.".format(target_nick)

    # 2. Instantiate and set serialized data
    uo = gh.Kernel.GH_UserObject()
    uo.BaseGuid = source_obj.ComponentGuid # Explicitly map the core component ID
    uo.SetDataFromObject(source_obj)

    # 3. Dynamically set Description properties
    # FIX: These Grasshopper API properties must remain capitalized (Category / SubCategory)
    uo.Description.Name = name if name else source_obj.Name
    uo.Description.Description = desc if desc else ""
    uo.Description.Category = category if category else "User"
    uo.Description.SubCategory = sub_category if sub_category else "Custom"

    # 4. Dynamically set Custom Icon if provided
    # By simply omitting an 'else' statement, Grasshopper naturally falls back to its default box icon
    if icon_path and os.path.exists(icon_path):
        try:
            uo.Icon = drawing.Bitmap.FromFile(icon_path)
        except Exception as e:
            return "Failed to load icon: " + str(e)

    # 5. Set Exposure (Visible in primary section of ribbon)
    uo.Exposure = gh.Kernel.GH_Exposure.primary

    # 6. Set Path and Save
    uo.CreateDefaultPath(True)
    attempted_path = uo.Path # Capture the path for debugging
    
    saved_successfully = uo.SaveToFile()
    
    # 7. Clear memory payload
    uo.Clear()

    if saved_successfully:
        return "Successfully created User Object at: " + attempted_path
    else:
        return "Error: Failed to write User Object file. Attempted Path: " + str(attempted_path)

# Assign result to output parameter 'UserObject'
if 'target_nick' in globals() and 'run' in globals():
    UserObject = build_user_object(target_nick, obj_name, obj_desc, category, sub_category, icon_path, run)
# ---------- end genuserobj ----------
paramcont1 = ParamController1(update=press_to_update_gh_def, csv_file=panel)  # inputs update: Boolean, csv_file: String
# ---------- paramcont1: Python ----------
"""
Updates Grasshopper parameters from a CSV file.

Inputs:
    update: Boolean (item access, bool)
    csv_file: String (item access, str)

Outputs:
    (None)
"""

try:
    ghenv.Component.Name = "ParamController1"
    ghenv.Component.NickName = "ParamCont1"
    ghenv.Component.Description = "Updates Grasshopper parameters from a CSV file."
except NameError:
    pass

import os
import csv
import Grasshopper as gh
import System

def get_gh_doc():
    if 'ghenv' in globals():
        return ghenv.Component.OnPingDocument()
    if 'ghdoc' in globals():
        return ghdoc
    return None

def find_param_by_nickname(doc, nickname):
    matched_params = []
    for obj in doc.Objects:
        if isinstance(obj, gh.Kernel.IGH_Param):
            if obj.NickName == nickname:
                matched_params.append(obj)
    return matched_params

def update_param_value(param, type_str, value_str, doc):
    type_str = type_str.lower().strip()
    value_str = value_str.strip()

    if type_str in ['float', 'num', 'number', 'double']:
        try:
            val = float(value_str)
            param.PersistentData.Clear()
            param.PersistentData.Append(gh.Kernel.Types.GH_Number(val))
            return True
        except ValueError:
            print("Error parsing {} as float".format(value_str))

    elif type_str in ['int', 'integer']:
        try:
            val = int(value_str)
            param.PersistentData.Clear()
            param.PersistentData.Append(gh.Kernel.Types.GH_Integer(val))
            return True
        except ValueError:
            print("Error parsing {} as int".format(value_str))

    elif type_str in ['string', 'str', 'text']:
        param.PersistentData.Clear()
        param.PersistentData.Append(gh.Kernel.Types.GH_String(value_str))
        return True

    elif type_str in ['bool', 'boolean']:
        val = value_str.lower() in ['true', '1', 't', 'yes', 'y']
        param.PersistentData.Clear()
        param.PersistentData.Append(gh.Kernel.Types.GH_Boolean(val))
        return True

    elif type_str in ['crv', 'curve', 'pt', 'point', 'geo', 'geometry', 'brep', 'srf', 'surface']:
        source_params = find_param_by_nickname(doc, value_str)
        if not source_params:
            print("Could not find source parameter with nickname '{}' on canvas".format(value_str))
            return False

        source_param = source_params[0]
        param.RemoveAllSources()
        param.AddSource(source_param)
        return True

    else:
        print("Unsupported type: {}".format(type_str))
        return False

PENDING_UPDATES = []

def schedule_callback(ghdoc):
    global PENDING_UPDATES

    if not PENDING_UPDATES:
        return

    updated_count = 0
    for param, type_str, value_str in PENDING_UPDATES:
        param.RecordUndoEvent("CSV Update")
        if update_param_value(param, type_str, value_str, ghdoc):
            param.ExpireSolution(False)
            updated_count += 1

    PENDING_UPDATES = []

    if updated_count > 0:
        print("Successfully updated {} parameters.".format(updated_count))
        ghdoc.NewSolution(False)

def main():
    global PENDING_UPDATES
    if 'update' not in globals() or not update:
        return

    if 'csv_file' not in globals() or not csv_file or not os.path.exists(csv_file):
        print("Invalid CSV file path or csv_file input not provided")
        return

    doc = get_gh_doc()
    if not doc:
        print("Could not find Grasshopper document context")
        return

    updated_count = 0

    with open(csv_file, mode='r') as f:
        reader = csv.reader(f)
        try:
            headers = next(reader)
        except StopIteration:
            headers = None

        if not headers:
            print("Empty CSV file")
            return

        header_lower = [h.lower().strip() for h in headers]

        try:
            name_idx = header_lower.index("input name")
            type_idx = header_lower.index("type")
            value_idx = header_lower.index("value")
        except ValueError:
            print("Warning: Could not find exact headers 'input name', 'type', 'value'. Assuming columns 0, 1, 2.")
            name_idx, type_idx, value_idx = 0, 1, 2

        PENDING_UPDATES = []
        for row in reader:
            if len(row) <= max(name_idx, type_idx, value_idx):
                continue

            input_name = row[name_idx]
            input_type = row[type_idx]
            input_value = row[value_idx]

            target_params = find_param_by_nickname(doc, input_name)
            if not target_params:
                print("Warning: No parameter found with NickName '{}'".format(input_name))
                continue

            for param in target_params:
                PENDING_UPDATES.append((param, input_type, input_value))
                updated_count += 1

    if updated_count > 0:
        delegate = gh.Kernel.GH_Document.GH_ScheduleDelegate(schedule_callback)
        doc.ScheduleSolution(5, delegate)

if __name__ == "__main__":
    main()
# ---------- end paramcont1 ----------
paramcont2 = ParamController2(update=press_to_update_gh_def, csv_file=panel, section="Section A (configured in csv)")  # inputs update: Boolean, csv_file: String, section: String
# ---------- paramcont2: Python ----------
"""
Updates Grasshopper parameters from a CSV file, with optional section filtering.

Inputs:
    update: Boolean (item access, bool)
    csv_file: String (item access, str)
    section: String (item access, str) [Optional]

Outputs:
    (None)
"""

try:
    ghenv.Component.Name = "ParamController2"
    ghenv.Component.NickName = "ParamCont2"
    ghenv.Component.Description = "Updates Grasshopper parameters from a CSV file, with optional section filtering."
except NameError:
    pass

import os
import csv
import Grasshopper as gh
import System

def get_gh_doc():
    if 'ghenv' in globals():
        return ghenv.Component.OnPingDocument()
    if 'ghdoc' in globals():
        return ghdoc
    return None

def find_param_by_nickname(doc, nickname):
    matched_params = []
    for obj in doc.Objects:
        if isinstance(obj, gh.Kernel.IGH_Param):
            if obj.NickName == nickname:
                matched_params.append(obj)
    return matched_params

def update_param_value(param, type_str, value_str, doc):
    type_str = type_str.lower().strip()
    value_str = value_str.strip()

    if type_str in ['float', 'num', 'number', 'double']:
        try:
            val = float(value_str)
            param.PersistentData.Clear()
            param.PersistentData.Append(gh.Kernel.Types.GH_Number(val))
            return True
        except ValueError:
            print("Error parsing {} as float".format(value_str))

    elif type_str in ['int', 'integer']:
        try:
            val = int(value_str)
            param.PersistentData.Clear()
            param.PersistentData.Append(gh.Kernel.Types.GH_Integer(val))
            return True
        except ValueError:
            print("Error parsing {} as int".format(value_str))

    elif type_str in ['string', 'str', 'text']:
        param.PersistentData.Clear()
        param.PersistentData.Append(gh.Kernel.Types.GH_String(value_str))
        return True

    elif type_str in ['bool', 'boolean']:
        val = value_str.lower() in ['true', '1', 't', 'yes', 'y']
        param.PersistentData.Clear()
        param.PersistentData.Append(gh.Kernel.Types.GH_Boolean(val))
        return True

    elif type_str in ['crv', 'curve', 'pt', 'point', 'geo', 'geometry', 'brep', 'srf', 'surface']:
        source_params = find_param_by_nickname(doc, value_str)
        if not source_params:
            print("Could not find source parameter with nickname '{}' on canvas".format(value_str))
            return False

        source_param = source_params[0]
        param.RemoveAllSources()
        param.AddSource(source_param)
        return True

    else:
        print("Unsupported type: {}".format(type_str))
        return False

PENDING_UPDATES = []

def schedule_callback(ghdoc):
    global PENDING_UPDATES

    if not PENDING_UPDATES:
        return

    updated_count = 0
    for param, type_str, value_str in PENDING_UPDATES:
        param.RecordUndoEvent("CSV Update")
        if update_param_value(param, type_str, value_str, ghdoc):
            param.ExpireSolution(False)
            updated_count += 1

    PENDING_UPDATES = []

    if updated_count > 0:
        print("Successfully updated {} parameters.".format(updated_count))
        ghdoc.NewSolution(False)

def main():
    global PENDING_UPDATES
    if 'update' not in globals() or not update:
        return

    if 'csv_file' not in globals() or not csv_file or not os.path.exists(csv_file):
        print("Invalid CSV file path or csv_file input not provided")
        return

    active_section = None
    if 'section' in globals() and section:
        active_section = str(section).strip()

    doc = get_gh_doc()
    if not doc:
        print("Could not find Grasshopper document context")
        return

    updated_count = 0

    with open(csv_file, mode='r') as f:
        reader = csv.reader(f)
        try:
            headers = next(reader)
        except StopIteration:
            headers = None

        if not headers:
            print("Empty CSV file")
            return

        header_lower = [h.lower().strip() for h in headers]

        try:
            name_idx = header_lower.index("input name")
            type_idx = header_lower.index("type")
            value_idx = header_lower.index("value")
        except ValueError:
            print("Warning: Could not find exact headers 'input name', 'type', 'value'. Assuming columns 0, 1, 2.")
            name_idx, type_idx, value_idx = 0, 1, 2
            
        try:
            section_idx = header_lower.index("section")
        except ValueError:
            section_idx = 3 if len(headers) > 3 else -1

        PENDING_UPDATES = []
        for row in reader:
            if len(row) <= max(name_idx, type_idx, value_idx):
                continue

            input_name = row[name_idx]
            input_type = row[type_idx]
            input_value = row[value_idx]
            
            row_section = None
            if section_idx != -1 and len(row) > section_idx:
                row_section = row[section_idx].strip()

            if active_section is not None:
                if not row_section or row_section != active_section:
                    continue

            target_params = find_param_by_nickname(doc, input_name)
            if not target_params:
                print("Warning: No parameter found with NickName '{}'".format(input_name))
                continue

            for param in target_params:
                PENDING_UPDATES.append((param, input_type, input_value))
                updated_count += 1

    if updated_count > 0:
        delegate = gh.Kernel.GH_Document.GH_ScheduleDelegate(schedule_callback)
        doc.ScheduleSolution(5, delegate)

if __name__ == "__main__":
    main()
# ---------- end paramcont2 ----------
paramexp = ParamExporter(export=press_to_export_csv, csv_file="*/sample/csv/file/path.csv")  # inputs export: Boolean, csv_file: String
# ---------- paramexp: Python ----------
"""
Exports Grasshopper top-level inputs to a CSV file.

Inputs:
    export: Boolean (item access, bool)
    csv_file: String (item access, str)

Outputs:
    (None)
"""

try:
    ghenv.Component.Name = "ParamExporter"
    ghenv.Component.NickName = "ParamExp"
    ghenv.Component.Description = "Exports Grasshopper top-level inputs to a CSV file."
except NameError:
    pass

import os
import csv
import Grasshopper as gh

def get_gh_doc():
    if 'ghenv' in globals():
        return ghenv.Component.OnPingDocument()
    if 'ghdoc' in globals():
        return ghdoc
    return None

def is_top_level(obj):
    if not isinstance(obj, gh.Kernel.IGH_Param):
        return True
    return obj.SourceCount == 0

def has_custom_nickname(obj):
    default_names = ['Number Slider', 'Boolean Toggle', 'Panel']
    if isinstance(obj, gh.Kernel.IGH_Param):
        if obj.NickName == obj.Name:
            return False
    if obj.NickName in default_names:
        return False
    if not obj.NickName or obj.NickName.strip() == "":
        return False
    return True

def get_param_type_str(obj):
    type_map = {
        'Number': 'float',
        'Integer': 'int',
        'String': 'string',
        'Text': 'string',
        'Boolean': 'bool',
        'Curve': 'crv',
        'Point': 'pt',
        'Geometry': 'geo',
        'Brep': 'brep',
        'Surface': 'srf'
    }

    if isinstance(obj, gh.Kernel.IGH_Param):
        type_name = obj.TypeName
        if type_name in type_map:
            return type_map[type_name]
        return type_name.lower()

    if isinstance(obj, gh.Kernel.Special.GH_NumberSlider):
        return "float" if obj.Slider.Type == gh.GUI.Base.GH_SliderAccuracy.Float else "int"
    if isinstance(obj, gh.Kernel.Special.GH_BooleanToggle):
        return "bool"
    if isinstance(obj, gh.Kernel.Special.GH_Panel):
        return "string"

    return "geo"

def extract_value(obj, type_str):
    if type_str in ['crv', 'pt', 'geo', 'brep', 'srf']:
        return obj.NickName

    if isinstance(obj, gh.Kernel.Special.GH_NumberSlider):
        return str(obj.CurrentValue)
    elif isinstance(obj, gh.Kernel.Special.GH_BooleanToggle):
        return str(obj.Value)
    elif isinstance(obj, gh.Kernel.Special.GH_Panel):
        return str(obj.UserText)

    if isinstance(obj, gh.Kernel.IGH_Param):
        if obj.VolatileDataCount > 0:
            first_branch = obj.VolatileData.Branches[0]
            if first_branch.Count > 0:
                if hasattr(first_branch[0], 'Value'):
                    return str(first_branch[0].Value)
                else:
                    return str(first_branch[0])
        elif not obj.PersistentData.IsEmpty:
            first_branch = obj.PersistentData.Branches[0]
            if first_branch.Count > 0:
                if hasattr(first_branch[0], 'Value'):
                    return str(first_branch[0].Value)
                else:
                    return str(first_branch[0])

    return ""

def main():
    if 'export' not in globals() or not export:
        return

    if 'csv_file' not in globals() or not csv_file:
        print("Invalid CSV file path or csv_file input not provided")
        return

    doc = get_gh_doc()
    if not doc:
        print("Could not find Grasshopper document context")
        return

    export_data = []
    export_data.append(["item name", "type", "value"])

    for obj in doc.Objects:
        is_param = isinstance(obj, gh.Kernel.IGH_Param)
        is_special = isinstance(obj, (gh.Kernel.Special.GH_NumberSlider, gh.Kernel.Special.GH_BooleanToggle, gh.Kernel.Special.GH_Panel))

        if is_param or is_special:
            if is_top_level(obj) and has_custom_nickname(obj):
                type_str = get_param_type_str(obj)
                val_str = extract_value(obj, type_str)

                name_str = obj.NickName

                if type_str in ['crv', 'pt', 'geo', 'brep', 'srf']:
                    name_str = "{}-1".format(name_str)

                export_data.append([name_str, type_str, val_str])

    if len(export_data) <= 1:
        print("No eligible components found to export.")
        return

    try:
        dir_name = os.path.dirname(csv_file)
        if dir_name and not os.path.exists(dir_name):
            os.makedirs(dir_name)

        with open(csv_file, mode='w', newline='') as f:
            writer = csv.writer(f)
            writer.writerows(export_data)

        print("Successfully exported {} parameters to {}.".format(len(export_data) - 1, csv_file))
    except Exception as e:
        print("Error writing to CSV: {}".format(e))

if __name__ == "__main__":
    main()
# ---------- end paramexp ----------
items_in_directory_as_list = Panel(dirfile)
report_appears_here = Panel(genuserobj)
number_slider = Slider(12, range=0..100)
number_slider_2 = Slider(12, range=0..100)

crv = Curve(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)
bndtrig = BoundTriGrid(boundary=crv, size_x=Slider(12, range=0..100), size_y=Slider(8, range=0..100))  # -> trigrid, bnd_rect; inputs boundary: Curve, size_x: Double, size_y: Double
# ---------- bndtrig: Python ----------
"""
Creates a grid of individual closed triangular cells within a region.

Inputs:
    boundary: Geometry (item access, crv)
    size_x: Number (item access, float)
    size_y: Number (item access, float)

Outputs:
    trigrid: List of Curves (The final individual closed triangular cells)
    bnd_rect: Curve (The bounding rectangle of the original input)
"""

try:
    ghenv.Component.Name = "BoundTriGrid"
    ghenv.Component.NickName = "BndTriG"
    ghenv.Component.Description = "Creates a grid of individual closed triangular cells within a region."
except NameError:
    pass

import Rhino.Geometry as rg

def create_closed_triangular_cells(region_geometry, size_x_val, size_y_val):
    if region_geometry is None: return [], None
    if size_x_val <= 0 or size_y_val <= 0: return [], None
    
    bbox = region_geometry.GetBoundingBox(rg.Plane.WorldXY)
    if not bbox.IsValid: return [], None

    p_min = bbox.Min
    p_max = bbox.Max
    
    pt_bl = rg.Point3d(p_min.X, p_min.Y, 0)
    pt_br = rg.Point3d(p_max.X, p_min.Y, 0)
    pt_tr = rg.Point3d(p_max.X, p_max.Y, 0)
    pt_tl = rg.Point3d(p_min.X, p_max.Y, 0)
    
    bnd_rect_curve = rg.PolylineCurve(rg.Polyline([pt_bl, pt_br, pt_tr, pt_tl, pt_bl]))
    
    width = p_max.X - p_min.X
    height = p_max.Y - p_min.Y
    
    if width <= 0 or height <= 0: return [], bnd_rect_curve

    cells_x = max(1, int(round(width / size_x_val)))
    cells_y = max(1, int(round(height / size_y_val)))
    
    actual_dx = width / float(cells_x)
    actual_dy = height / float(cells_y)

    final_triangles = []
    tol = 1e-5 

    for row in range(cells_y):
        y_start = p_min.Y + (row * actual_dy)
        y_end = y_start + actual_dy
        
        for col in range(cells_x):
            x_start = p_min.X + (col * actual_dx)
            x_end = x_start + actual_dx
            
            if (x_start >= p_min.X - tol and 
                x_end <= p_max.X + tol and 
                y_start >= p_min.Y - tol and 
                y_end <= p_max.Y + tol):
                
                # Define the four corners of the current rectangular cell
                pt0 = rg.Point3d(x_start, y_start, 0) # Bottom-Left
                pt1 = rg.Point3d(x_end, y_start, 0)   # Bottom-Right
                pt2 = rg.Point3d(x_end, y_end, 0)     # Top-Right
                pt3 = rg.Point3d(x_start, y_end, 0)   # Top-Left
                
                # Alternate the diagonal split to create a continuous triangular diagrid pattern
                if (row + col) % 2 == 0:
                    # Split from Top-Left to Bottom-Right (\)
                    pline1 = rg.Polyline([pt0, pt1, pt3, pt0])
                    pline2 = rg.Polyline([pt1, pt2, pt3, pt1])
                else:
                    # Split from Bottom-Left to Top-Right (/)
                    pline1 = rg.Polyline([pt0, pt1, pt2, pt0])
                    pline2 = rg.Polyline([pt0, pt2, pt3, pt0])
                
                final_triangles.append(rg.PolylineCurve(pline1))
                final_triangles.append(rg.PolylineCurve(pline2))

    return final_triangles, bnd_rect_curve

if 'boundary' in globals() and 'size_x' in globals() and 'size_y' in globals():
    trigrid, bnd_rect = create_closed_triangular_cells(boundary, size_x, size_y)
# ---------- end bndtrig ----------
crv_2 = Curve(bndtrig.trigrid)

crv_3 = Curve(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)
crv_4 = Curve(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)
crv_5 = Curve([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])
crv_6 = Curve(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)
bndtrim = BoundaryTrim(curves=crv_5, region=crv_6)  # -> trimmed_curves; inputs curves: list of Curve, region: Curve
# ---------- bndtrim: Python ----------
"""
Utility to trim curves with a region, closing the curves along the intersection boundary if they were originally closed.

Inputs:
    curves: List of Curves (The open or closed curves to be trimmed)
    region: Curve (The closed boundary region to trim the curves against)

Outputs:
    trimmed_curves: List of Curves (The resulting trimmed and appropriately closed curves)
"""

try:
    ghenv.Component.Name = "BoundaryTrim"
    ghenv.Component.NickName = "BndTrim"
    ghenv.Component.Description = "Utility to trim curves with a region, closing the curves along the intersection boundary if they were originally closed."
except NameError:
    pass

import Rhino.Geometry as rg
import scriptcontext as sc

tol = sc.doc.ModelAbsoluteTolerance
trimmed_curves = []

if curves and region:
    if region.IsClosed:
        rc, reg_plane = region.TryGetPlane(tol)
        if not rc:
            reg_plane = rg.Plane.WorldXY
            
        for crv in curves:
            if crv is None:
                continue
                
            if crv.IsClosed:
                res = rg.Curve.CreateBooleanIntersection(crv, region, tol)
                if res:
                    trimmed_curves.extend(res)
            
            else:
                intersections = rg.Intersect.Intersection.CurveCurve(crv, region, tol, tol)
                
                if intersections and intersections.Count > 0:
                    params = []
                    for i in range(intersections.Count):
                        params.append(intersections[i].ParameterA)
                    
                    split_crvs = crv.Split(params)
                    
                    if split_crvs:
                        for s_crv in split_crvs:
                            mid_pt = s_crv.PointAt(s_crv.Domain.Mid)
                            if region.Contains(mid_pt, reg_plane, tol) == rg.PointContainment.Inside:
                                trimmed_curves.append(s_crv)
                    else:
                        mid_pt = crv.PointAt(crv.Domain.Mid)
                        if region.Contains(mid_pt, reg_plane, tol) == rg.PointContainment.Inside:
                            trimmed_curves.append(crv)
                            
                else:
                    mid_pt = crv.PointAt(crv.Domain.Mid)
                    if region.Contains(mid_pt, reg_plane, tol) == rg.PointContainment.Inside:
                        trimmed_curves.append(crv)
# ---------- end bndtrim ----------
bndrectg = BoundRectGrid(boundary=crv_3, size_x=number_slider, size_y=number_slider_2)  # -> rectgrid, bnd_rect; inputs boundary: Curve, size_x: Double, size_y: Double
# ---------- bndrectg: Python ----------
"""
Creates a grid of individual closed rectangular cells within a region.

Inputs:
    boundary: Geometry (item access, crv)
    size_x: Number (item access, float)
    size_y: Number (item access, float)

Outputs:
    rectgrid: List of Curves (The final individual closed rectangular cells)
    bnd_rect: Curve (The bounding rectangle of the original input)
"""

try:
    ghenv.Component.Name = "BoundRectGrid"
    ghenv.Component.NickName = "BndRectG"
    ghenv.Component.Description = "Creates a grid of individual closed rectangular cells within a region."
except NameError:
    pass

import Rhino.Geometry as rg

def create_closed_rect_cells(region_geometry, size_x_val, size_y_val):
    if region_geometry is None: return [], None
    if size_x_val <= 0 or size_y_val <= 0: return [], None

    bbox = region_geometry.GetBoundingBox(rg.Plane.WorldXY)
    if not bbox.IsValid: return [], None

    p_min = bbox.Min
    p_max = bbox.Max

    pt_bl = rg.Point3d(p_min.X, p_min.Y, 0)
    pt_br = rg.Point3d(p_max.X, p_min.Y, 0)
    pt_tr = rg.Point3d(p_max.X, p_max.Y, 0)
    pt_tl = rg.Point3d(p_min.X, p_max.Y, 0)

    bnd_rect_curve = rg.PolylineCurve(rg.Polyline([pt_bl, pt_br, pt_tr, pt_tl, pt_bl]))

    width = p_max.X - p_min.X
    height = p_max.Y - p_min.Y

    if width <= 0 or height <= 0: return [], bnd_rect_curve

    cells_x = max(1, int(round(width / size_x_val)))
    cells_y = max(1, int(round(height / size_y_val)))

    actual_dx = width / float(cells_x)
    actual_dy = height / float(cells_y)

    final_rects = []
    tol = 1e-5

    for row in range(-2, cells_y + 4):
        cy = p_min.Y + (actual_dy / 2.0) + (row * actual_dy)

        for col in range(-2, cells_x + 4):
            cx = p_min.X + (actual_dx / 2.0) + (col * actual_dx)

            if (cx - actual_dx/2.0 >= p_min.X - tol and
                cx + actual_dx/2.0 <= p_max.X + tol and
                cy - actual_dy/2.0 >= p_min.Y - tol and
                cy + actual_dy/2.0 <= p_max.Y + tol):

                pt0 = rg.Point3d(cx - actual_dx/2.0, cy - actual_dy/2.0, 0)
                pt1 = rg.Point3d(cx + actual_dx/2.0, cy - actual_dy/2.0, 0)
                pt2 = rg.Point3d(cx + actual_dx/2.0, cy + actual_dy/2.0, 0)
                pt3 = rg.Point3d(cx - actual_dx/2.0, cy + actual_dy/2.0, 0)

                pline = rg.Polyline([pt0, pt1, pt2, pt3, pt0])
                final_rects.append(rg.PolylineCurve(pline))

    return final_rects, bnd_rect_curve

if 'boundary' in globals() and 'size_x' in globals() and 'size_y' in globals():
    rectgrid, bnd_rect = create_closed_rect_cells(boundary, size_x, size_y)
# ---------- end bndrectg ----------
bndhexg = BoundHexGrid(boundary=crv_3, size_x=number_slider, size_y=number_slider_2)  # -> hexgrid, bnd_rect; inputs boundary: Curve, size_x: Double, size_y: Double
# ---------- bndhexg: Python ----------
"""
Creates a grid of individual closed hexagonal cells within a region.

Inputs:
    boundary: Geometry (item access, crv)
    size_x: Number (item access, float)
    size_y: Number (item access, float)

Outputs:
    hexgrid: List of Curves (The final individual closed hexagonal cells)
    bnd_rect: Curve (The bounding rectangle of the original input)
"""

try:
    ghenv.Component.Name = "BoundHexGrid"
    ghenv.Component.NickName = "BndHexG"
    ghenv.Component.Description = "Creates a grid of individual closed hexagonal cells within a region."
except NameError:
    pass

import Rhino.Geometry as rg
import math

def create_closed_hex_cells(region_geometry, size_x_val, size_y_val):
    if region_geometry is None: return [], None
    if size_x_val <= 0 or size_y_val <= 0: return [], None

    bbox = region_geometry.GetBoundingBox(rg.Plane.WorldXY)
    if not bbox.IsValid: return [], None

    p_min = bbox.Min
    p_max = bbox.Max

    pt_bl = rg.Point3d(p_min.X, p_min.Y, 0)
    pt_br = rg.Point3d(p_max.X, p_min.Y, 0)
    pt_tr = rg.Point3d(p_max.X, p_max.Y, 0)
    pt_tl = rg.Point3d(p_min.X, p_max.Y, 0)

    bnd_rect_curve = rg.PolylineCurve(rg.Polyline([pt_bl, pt_br, pt_tr, pt_tl, pt_bl]))

    width = p_max.X - p_min.X
    height = p_max.Y - p_min.Y

    if width <= 0 or height <= 0: return [], bnd_rect_curve

    cells_x = max(1, int(round(width / size_x_val)))
    cells_y = max(1, int(round(height / (size_y_val * 0.75))))

    actual_dx = width / float(cells_x)
    actual_dy = height / float(cells_y)

    rx = actual_dx / math.sqrt(3.0)
    ry = actual_dy / 1.5

    final_hexes = []
    tol = 1e-5

    for row in range(-2, cells_y + 4):
        cy = p_min.Y + (actual_dy / 2.0) + (row * actual_dy)

        if row % 2 == 0:
            cx_start = p_min.X + (actual_dx / 2.0)
        else:
            cx_start = p_min.X + actual_dx

        for col in range(-2, cells_x + 4):
            cx = cx_start + col * actual_dx

            if (cx - actual_dx/2.0 >= p_min.X - tol and
                cx + actual_dx/2.0 <= p_max.X + tol and
                cy - actual_dy/2.0 >= p_min.Y - tol and
                cy + actual_dy/2.0 <= p_max.Y + tol):

                pts = []
                for k in range(6):
                    ang = math.radians(30.0 + 60.0 * k)
                    vx = cx + rx * math.cos(ang)
                    vy = cy + ry * math.sin(ang)
                    pts.append(rg.Point3d(vx, vy, 0.0))
                pts.append(pts[0])

                pline = rg.Polyline(pts)
                final_hexes.append(rg.PolylineCurve(pline))

    return final_hexes, bnd_rect_curve

if 'boundary' in globals() and 'size_x' in globals() and 'size_y' in globals():
    hexgrid, bnd_rect = create_closed_hex_cells(boundary, size_x, size_y)
# ---------- end bndhexg ----------
bndrectg_2 = BoundRectGrid()  # -> rectgrid, bnd_rect; inputs boundary: Curve, size_x: Double, size_y: Double; same code as bndrectg
bndpan = BoundPanel(boundary=crv_4, size_x=Slider(42, range=0..100), size_y=Slider(31, range=0..100))  # -> panels; inputs boundary: Curve, size_x: Double, size_y: Double, use_world_xy: Boolean
# ---------- bndpan: Python ----------
"""
Creates a grid of rectangular panels that perfectly fit within a bounding curve.

Inputs:
    boundary: Geometry (item access, crv)
    size_x: Number (item access, float)
    size_y: Number (item access, float)
    use_world_xy: Boolean (item access, bool)

Outputs:
    panels: List of Curves (The rectangular panels)
"""

try:
    ghenv.Component.Name = "BoundPanel"
    ghenv.Component.NickName = "BndPan"
    ghenv.Component.Description = "Creates a grid of rectangular panels that perfectly fit within a bounding curve."
except NameError:
    pass

import Rhino
import scriptcontext as sc
from Rhino.Geometry import Plane, Rectangle3d, Interval

def _doc_tol():
    if sc.doc:
        return sc.doc.ModelAbsoluteTolerance
    if Rhino.RhinoDoc.ActiveDoc:
        return Rhino.RhinoDoc.ActiveDoc.ModelAbsoluteTolerance
    return 1e-3

def sizes_1d(L, S, tol):
    if S <= tol:
        return [L]

    n_full = int(L // S)
    rem = L - (n_full * S)

    if abs(rem) <= tol:
        return [S] * n_full

    cap = 0.5 * rem

    if cap <= tol:
        return [S] * n_full

    return [cap] + ([S] * n_full) + [cap]

panels = []

if 'boundary' in globals() and boundary is not None:
    tol = _doc_tol()

    if 'use_world_xy' in globals() and use_world_xy:
        pl = Plane.WorldXY
    else:
        ok, pl = boundary.TryGetPlane(tol)
        if not ok:
            pl = Plane.WorldXY

    bb = boundary.GetBoundingBox(pl)

    Lx = bb.Max.X - bb.Min.X
    Ly = bb.Max.Y - bb.Min.Y

    x_sizes = sizes_1d(Lx, float(size_x), tol)
    y_sizes = sizes_1d(Ly, float(size_y), tol)

    x0 = bb.Min.X
    for sx in x_sizes:
        y0 = bb.Min.Y
        for sy in y_sizes:
            rect = Rectangle3d(
                pl,
                Interval(x0, x0 + sx),
                Interval(y0, y0 + sy)
            )
            panels.append(rect.ToNurbsCurve())
            y0 += sy
        x0 += sx
# ---------- end bndpan ----------
crv_7 = Curve(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)
bndhexg_2 = BoundHexGrid(boundary=crv_7, size_x=Slider(16, range=0..100), size_y=Slider(16, range=0..100))  # -> hexgrid, bnd_rect; inputs boundary: Curve, size_x: Double, size_y: Double; same code as bndhexg
crv_8 = Curve(bndrectg.rectgrid)
crv_9 = Curve(bndpan)
srf_2 = Surface(bndtrim)
area = Area(Geometry=bndhexg_2.hexgrid)  # -> Area, Centroid
disc = Discontinuity(Curve=bndhexg_2.hexgrid, Level=1)  # -> Points, Parameters
ln = Line(StartPoint=disc.Points, EndPoint=graft(area.Centroid))
number_slider_3 = Slider(47, range=0..100)
number_slider_4 = Slider(1, range=0..1)
gridfpyra = GridFoldPyramid(grid_cells=bndhexg_2.hexgrid, fold_lines=ln, fold_angle=number_slider_3, solid=number_slider_4)  # -> folded_cells; inputs grid_cells: list of GeometryBase, fold_lines: tree of Curve, fold_angle: Double, solid: Boolean
# ---------- gridfpyra: Python ----------
"""
Creates folded 3-dimensional gridded geometries efficiently from planar cells and fold lines.

Inputs:
    grid_cells: List of Curves (list access, closed crv)
    fold_lines: DataTree of Curves (tree access, open crv)
    fold_angle: Number (item access, float)
    solid: Boolean (item access, bool)

Outputs:
    folded_cells: List of Breps (The final 3D folded geometries)
"""

import Rhino.Geometry as rg
import math
import scriptcontext as sc

try:
    ghenv.Component.Name = "GridFoldPyramid"
    ghenv.Component.NickName = "GridFPyra"
    ghenv.Component.Description = "Creates folded 3D gridded geometries efficiently."
except NameError:
    pass

folded_cells = []
tol = sc.doc.ModelAbsoluteTolerance

if grid_cells and fold_lines and fold_angle is not None:
    # Set default for solid toggle if no boolean is provided
    solid_toggle = False if solid is None else solid
    
    # Convert input angle from degrees to radians
    angle_rad = math.radians(fold_angle)
    
    # Check if DataTree branches perfectly match the list of cells
    match_trees = fold_lines.BranchCount == len(grid_cells)
    
    flat_fold_lines = []
    if not match_trees and not solid_toggle:
        if hasattr(fold_lines, 'AllData'):
            flat_fold_lines = fold_lines.AllData()
        else:
            flat_fold_lines = fold_lines

    for i, cell in enumerate(grid_cells):
        if not cell or not cell.IsClosed:
            continue
            
        # Create planar surface from cell
        breps = rg.Brep.CreatePlanarBreps(cell, tol)
        if not breps:
            continue
        base_brep = breps[0]
        
        # Determine the plane of the cell to establish a consistent normal
        success, plane = cell.TryGetPlane(tol)
        if not success:
            plane = rg.Plane.WorldXY
        normal = plane.ZAxis
        
        # ---------------------------------------------------------
        # MODE 1: CLOSED SOLID PYRAMID
        # ---------------------------------------------------------
        if solid_toggle:
            amp = rg.AreaMassProperties.Compute(cell)
            if not amp:
                folded_cells.append(base_brep)
                continue
                
            apex_base = amp.Centroid
            
            # Find distance to closest edge to calculate a uniform apex height
            success, t = cell.ClosestPoint(apex_base)
            dist_to_edge = apex_base.DistanceTo(cell.PointAt(t))
            
            # Calculate exact height using trigonometry
            height = dist_to_edge * math.tan(angle_rad)
            apex_pt = apex_base + (normal * height)
            
            breps_to_join = [base_brep]
            segments = cell.DuplicateSegments()
            
            # Build the side faces of the solid pyramid
            for seg in segments:
                ptA = seg.PointAtStart
                ptB = seg.PointAtEnd
                srf = rg.Brep.CreateFromCornerPoints(ptA, ptB, apex_pt, tol)
                if srf:
                    breps_to_join.append(srf)
            
            # Stitch it all together into a watertight closed Brep
            joined = rg.Brep.JoinBreps(breps_to_join, tol)
            if joined:
                folded_cells.append(joined[0])
            else:
                folded_cells.append(base_brep)
            continue
            
        # ---------------------------------------------------------
        # MODE 2: OPEN FOLDED PANELS (Original Logic)
        # ---------------------------------------------------------
        associated_lines = []
        if match_trees:
            associated_lines = fold_lines.Branch(i)
        else:
            for f_line in flat_fold_lines:
                if not f_line: continue
                mp = f_line.PointAtNormalizedLength(0.5)
                containment = cell.Contains(mp, plane, tol)
                if containment == rg.PointContainment.Inside or containment == rg.PointContainment.Coincident:
                    associated_lines.append(f_line)
        
        if not associated_lines:
            folded_cells.append(base_brep)
            continue
            
        split_breps = base_brep.Split(associated_lines, tol)
        
        if not split_breps:
            folded_cells.append(base_brep)
            continue
            
        for s_brep in split_breps:
            hinge_edge = None
            
            for edge in s_brep.Edges:
                edge_mp = edge.PointAtNormalizedLength(0.5)
                success, t = cell.ClosestPoint(edge_mp)
                if success and edge_mp.DistanceTo(cell.PointAt(t)) <= tol * 10:
                    hinge_edge = edge
                    break
                    
            if hinge_edge:
                vertices = s_brep.Vertices
                pt_sum = rg.Point3d.Origin
                for v in vertices:
                    pt_sum += v.Location
                face_center = pt_sum / vertices.Count
                
                edge_mp = hinge_edge.PointAtNormalizedLength(0.5)
                
                axis_vec = hinge_edge.PointAtEnd - hinge_edge.PointAtStart
                vec_inward = face_center - edge_mp
                
                cross = rg.Vector3d.CrossProduct(axis_vec, vec_inward)
                if cross * normal < 0:
                    axis_vec.Reverse()
                
                center_pt = hinge_edge.PointAtStart
                
                xform = rg.Transform.Rotation(angle_rad, axis_vec, center_pt)
                s_brep.Transform(xform)
                
            folded_cells.append(s_brep)
# ---------- end gridfpyra ----------
gridfwed = GridFoldWedge(grid_cells=bndhexg_2.hexgrid, fold_lines=ln, fold_angle=number_slider_3, solid=number_slider_4)  # -> folded_cells; inputs grid_cells: list of GeometryBase, fold_lines: tree of Curve, fold_angle: Double, solid: Boolean
# ---------- gridfwed: Python ----------
"""
Creates folded 3-dimensional gridded geometries efficiently from planar cells and fold lines.
Includes an option to output closed solid wedges for each folded fragment.

Inputs:
    grid_cells: List of Curves (list access, closed crv)
    fold_lines: DataTree of Curves (tree access, open crv)
    fold_angle: Number (item access, float)
    solid: Boolean (item access, bool)

Outputs:
    folded_cells: List of Breps (The final 3D folded geometries)
"""

import Rhino.Geometry as rg
import math
import scriptcontext as sc

try:
    ghenv.Component.Name = "GridFoldWedge"
    ghenv.Component.NickName = "GridFWed"
    ghenv.Component.Description = "Creates folded 3D gridded geometries efficiently."
except NameError:
    pass

folded_cells = []
tol = sc.doc.ModelAbsoluteTolerance

if grid_cells and fold_lines and fold_angle is not None:
    # Set default for solid toggle if no boolean is provided
    solid_toggle = False if solid is None else solid
    
    # Convert input angle from degrees to radians
    angle_rad = math.radians(fold_angle)
    
    # Check if DataTree branches perfectly match the list of cells
    match_trees = fold_lines.BranchCount == len(grid_cells)
    
    flat_fold_lines = []
    if not match_trees:
        if hasattr(fold_lines, 'AllData'):
            flat_fold_lines = fold_lines.AllData()
        else:
            flat_fold_lines = fold_lines

    for i, cell in enumerate(grid_cells):
        if not cell or not cell.IsClosed:
            continue
            
        # Create planar surface from cell
        breps = rg.Brep.CreatePlanarBreps(cell, tol)
        if not breps:
            continue
        base_brep = breps[0]
        
        # Determine the plane of the cell to establish a consistent normal
        success, plane = cell.TryGetPlane(tol)
        if not success:
            plane = rg.Plane.WorldXY
        normal = plane.ZAxis
            
        associated_lines = []
        if match_trees:
            associated_lines = fold_lines.Branch(i)
        else:
            for f_line in flat_fold_lines:
                if not f_line: continue
                mp = f_line.PointAtNormalizedLength(0.5)
                containment = cell.Contains(mp, plane, tol)
                if containment == rg.PointContainment.Inside or containment == rg.PointContainment.Coincident:
                    associated_lines.append(f_line)
        
        if not associated_lines:
            folded_cells.append(base_brep)
            continue
            
        # Split the cell's face using the inner fold lines
        split_breps = base_brep.Split(associated_lines, tol)
        
        if not split_breps:
            folded_cells.append(base_brep)
            continue
            
        for s_brep in split_breps:
            hinge_edge = None
            
            # Find the hinge edge along the outer boundary
            for edge in s_brep.Edges:
                edge_mp = edge.PointAtNormalizedLength(0.5)
                success, t = cell.ClosestPoint(edge_mp)
                if success and edge_mp.DistanceTo(cell.PointAt(t)) <= tol * 10:
                    hinge_edge = edge
                    break
                    
            if hinge_edge:
                # Find mathematical center to establish fold direction
                vertices = s_brep.Vertices
                pt_sum = rg.Point3d.Origin
                for v in vertices:
                    pt_sum += v.Location
                face_center = pt_sum / vertices.Count
                
                edge_mp = hinge_edge.PointAtNormalizedLength(0.5)
                
                axis_vec = hinge_edge.PointAtEnd - hinge_edge.PointAtStart
                vec_inward = face_center - edge_mp
                
                # Cross product logic to ensure panel folds "up"
                cross = rg.Vector3d.CrossProduct(axis_vec, vec_inward)
                if cross * normal < 0:
                    axis_vec.Reverse()
                
                center_pt = hinge_edge.PointAtStart
                xform = rg.Transform.Rotation(angle_rad, axis_vec, center_pt)
                
                # ---------------------------------------------------------
                # SOLID WEDGE LOGIC
                # ---------------------------------------------------------
                if solid_toggle:
                    flat_face = s_brep.DuplicateBrep()
                    rot_face = s_brep.DuplicateBrep()
                    rot_face.Transform(xform)
                    
                    breps_to_join = [flat_face, rot_face]
                    
                    # Iterate through the edges to build side walls
                    for e_idx in range(flat_face.Edges.Count):
                        edge_f = flat_face.Edges[e_idx].ToNurbsCurve()
                        edge_r = rot_face.Edges[e_idx].ToNurbsCurve()
                        
                        mp_f = edge_f.PointAtNormalizedLength(0.5)
                        mp_r = edge_r.PointAtNormalizedLength(0.5)
                        
                        # Only build a side wall if the edge actually moved (skip the hinge)
                        if mp_f.DistanceTo(mp_r) > tol * 10:
                            ruled_srf = rg.NurbsSurface.CreateRuledSurface(edge_f, edge_r)
                            if ruled_srf:
                                breps_to_join.append(rg.Brep.CreateFromSurface(ruled_srf))
                                
                    # Stitch the base, top, and walls into a closed solid
                    joined = rg.Brep.JoinBreps(breps_to_join, tol)
                    if joined:
                        folded_cells.append(joined[0])
                    else:
                        # Fallback just in case joining fails on a bad tolerance
                        folded_cells.append(rot_face)
                        
                # ---------------------------------------------------------
                # OPEN PLANAR LOGIC
                # ---------------------------------------------------------
                else:
                    rot_face = s_brep.DuplicateBrep()
                    rot_face.Transform(xform)
                    folded_cells.append(rot_face)
            else:
                folded_cells.append(s_brep)
# ---------- end gridfwed ----------
gridfplan = GridFoldPlanar(grid_cells=bndhexg_2.hexgrid, fold_lines=ln, fold_angle=number_slider_3)  # -> folded_cells; inputs grid_cells: list of GeometryBase, fold_lines: tree of Curve, fold_angle: Double
# ---------- gridfplan: Python ----------
"""
Creates folded 3-dimensional gridded geometries efficiently from planar cells and fold lines.

Inputs:
    grid_cells: List of Curves (list access, closed crv)
    fold_lines: DataTree of Curves (tree access, open crv)
    fold_angle: Number (item access, float)

Outputs:
    folded_cells: List of Breps (The final 3D folded geometries)
"""

import Rhino.Geometry as rg
import math
import scriptcontext as sc
import Grasshopper as gh

try:
    ghenv.Component.Name = "GridFoldPlanar"
    ghenv.Component.NickName = "GridFPlan"
    ghenv.Component.Description = "Creates folded 3D gridded geometries efficiently."
except NameError:
    pass

folded_cells = []
tol = sc.doc.ModelAbsoluteTolerance

if grid_cells and fold_lines and fold_angle is not None:
    # Convert input angle from degrees to radians
    angle_rad = math.radians(fold_angle)
    
    # OPTIMIZATION 1: Check if DataTree branches perfectly match the list of cells
    # This allows us to use O(1) Index matching instead of O(N^2) Spatial searching
    match_trees = fold_lines.BranchCount == len(grid_cells)
    
    # Fallback to a flat list just in case you flatten the tree in the future
    flat_fold_lines = []
    if not match_trees:
        if hasattr(fold_lines, 'AllData'):
            flat_fold_lines = fold_lines.AllData()
        else:
            flat_fold_lines = fold_lines

    for i, cell in enumerate(grid_cells):
        if not cell or not cell.IsClosed:
            continue
            
        # Create planar surface from cell
        breps = rg.Brep.CreatePlanarBreps(cell, tol)
        if not breps:
            continue
        base_brep = breps[0]
        
        # Determine the plane of the cell to establish a consistent normal
        success, plane = cell.TryGetPlane(tol)
        if not success:
            plane = rg.Plane.WorldXY
        normal = plane.ZAxis
            
        associated_lines = []
        if match_trees:
            # Grab lines directly by index (Instantaneous)
            associated_lines = fold_lines.Branch(i)
        else:
            # Fallback to slow spatial check ONLY if the data tree structure is broken/flattened
            for f_line in flat_fold_lines:
                if not f_line: continue
                mp = f_line.PointAtNormalizedLength(0.5)
                containment = cell.Contains(mp, plane, tol)
                if containment == rg.PointContainment.Inside or containment == rg.PointContainment.Coincident:
                    associated_lines.append(f_line)
        
        if not associated_lines:
            folded_cells.append(base_brep)
            continue
            
        # Split the cell's face using the inner fold lines
        split_breps = base_brep.Split(associated_lines, tol)
        
        if not split_breps:
            folded_cells.append(base_brep)
            continue
            
        # Rotate each fragment around its outer bounding edge (the hinge)
        for s_brep in split_breps:
            hinge_edge = None
            
            for edge in s_brep.Edges:
                edge_mp = edge.PointAtNormalizedLength(0.5)
                success, t = cell.ClosestPoint(edge_mp)
                if success and edge_mp.DistanceTo(cell.PointAt(t)) <= tol * 10:
                    hinge_edge = edge
                    break
                    
            if hinge_edge:
                # OPTIMIZATION 2: Simple arithmetic average instead of AreaMassProperties
                # This mathematically finds a localized "center" point instantaneously 
                vertices = s_brep.Vertices
                pt_sum = rg.Point3d.Origin
                for v in vertices:
                    pt_sum += v.Location
                face_center = pt_sum / vertices.Count
                
                edge_mp = hinge_edge.PointAtNormalizedLength(0.5)
                
                # Define initial rotation axis based on the hinge line
                axis_vec = hinge_edge.PointAtEnd - hinge_edge.PointAtStart
                vec_inward = face_center - edge_mp
                
                # Use Cross Product to guarantee uniform "Up" folding
                cross = rg.Vector3d.CrossProduct(axis_vec, vec_inward)
                if cross * normal < 0:
                    axis_vec.Reverse()
                
                center_pt = hinge_edge.PointAtStart
                
                # Apply rotation 
                xform = rg.Transform.Rotation(angle_rad, axis_vec, center_pt)
                s_brep.Transform(xform)
                
            folded_cells.append(s_brep)
# ---------- end gridfplan ----------
panel_2 = Panel("C:\Users\fharker\Documents\GitHub-Local\aria-office-facade\images-new\X.png")
num = Number([0.698039, 0.407843, 0.447059, 0.698039, 0.568627, 0.435294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])
pt_2 = Point([Point(6, 3, 0), Point(18, 3, 0), Point(30, 3, 0), Point(42, 3, 0), Point(54, 3, 0), Point(66, 3, 0)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])
num_2 = Number([0.698039, 0.407843, 0.447059, 0.698039, 0.568627, 0.435294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])
geo_2 = Geometry(gridfplan)
geo_3 = Geometry(gridfpyra)
geo_4 = Geometry(gridfwed)
stepround = StepRounding(values=num, step=Slider(0.05, range=0..0.1))  # -> stepped_values; inputs values: list of Double, step: Double
# ---------- stepround: Python ----------
"""
Rounds a list of numbers to the nearest specified step value.

Inputs:
    values: List (The unrounded list of values)
    step: Float (Numeric step for rounding)

Outputs:
    stepped_values: List (The newly rounded values)
"""

try:
    ghenv.Component.Name = "Step Rounding"
    ghenv.Component.NickName = "StepRound"
    ghenv.Component.Description = "Rounds a list of numbers to the nearest value of a given step."
except NameError:
    pass

# Initialize the output list
stepped_values = []

# Execute only if both inputs are provided
if values and step:
    for val in values:
        # Calculate the nearest step multiplier
        raw_rounded = round(val / step) * step
        
        # Clean up floating point precision artifacts (e.g., 0.350000000000001)
        # Rounding to 8 decimal places provides a clean output for Grasshopper
        clean_rounded = round(raw_rounded, 8)
        
        stepped_values.append(clean_rounded)
# ---------- end stepround ----------
valremap = RemapValues(values=num_2, value_a=Slider(0.125, range=0..1), value_b=Slider(0.875, range=0..1))  # -> remapped_values; inputs values: list of Double, value_a: Double, value_b: Double
# ---------- valremap: Python ----------
"""
Remaps a list of values to a new target domain defined by user inputs.

Inputs:
    values: List of Numbers (The list of values to be remapped)
    value_a: Number (The start value of the target domain)
    value_b: Number (The end value of the target domain)

Outputs:
    remapped_values: List of Numbers (The remapped values)
"""

try:
    ghenv.Component.Name = "RemapValues"
    ghenv.Component.NickName = "ValRemap"
    ghenv.Component.Description = "Remaps a list of values to a new target domain defined by user inputs."
except NameError:
    pass

remapped_values = []

if values and value_a is not None and value_b is not None:
    min_val = min(values)
    max_val = max(values)
    
    orig_domain = max_val - min_val
    target_domain = value_b - value_a
    
    for val in values:
        if orig_domain == 0.0:
            remapped_values.append(value_a)
        else:
            mapped_val = value_a + (val - min_val) * (target_domain / orig_domain)
            remapped_values.append(mapped_val)
# ---------- end valremap ----------
randvalgen = RandomValueGenerator(
    count=Slider(111, range=0..1000),
    min_val=Slider(0, range=0..1000),
    max_val=Slider(5, range=0..1000),
    as_int=Slider(0, range=0..100),
    seed=Slider(3, range=0..10))  # -> values; inputs count: Int32, min_val: Double, max_val: Double, as_int: Boolean, seed: Int32
# ---------- randvalgen: Python ----------
"""
Generates a list of random numbers (float or integer) within a specified range.

Inputs:
    count: Integer (Number of random values to generate)
    min_val: Number (Minimum random value)
    max_val: Number (Maximum random value)
    as_int: Boolean (0 = float, 1 = integer)
    seed: Integer (Randomness seed for reproducible results)

Outputs:
    values: List of Numbers (The generated random values)
"""

try:
    ghenv.Component.Name = "RandomValueGenerator"
    ghenv.Component.NickName = "RandValGen"
    ghenv.Component.Description = "Generates a list of random float or integer numbers within a specified range."
except NameError:
    pass

import random

def generate_random_values(num_count, minimum, maximum, as_integer, rand_seed):
    if num_count is None or num_count <= 0:
        return []
    if minimum is None or maximum is None:
        return []
        
    if rand_seed is not None:
        random.seed(rand_seed)
        
    actual_min = min(minimum, maximum)
    actual_max = max(minimum, maximum)
    
    generated_values = []
    
    for _ in range(int(num_count)):
        if as_integer:
            # Casts the limits to integers and generates an inclusive integer
            val = random.randint(int(actual_min), int(actual_max))
        else:
            # Generates a float
            val = random.uniform(actual_min, actual_max)
            
        generated_values.append(val)
        
    return generated_values

if 'count' in globals() and 'min_val' in globals() and 'max_val' in globals():
    seed_val = seed if 'seed' in globals() else None
    as_int_val = as_int if 'as_int' in globals() else False
    values = generate_random_values(count, min_val, max_val, as_int_val, seed_val)
# ---------- end randvalgen ----------
imghue = ImageHue(image_path=panel_2, points=pt_2)  # -> values; inputs image_path: String, points: list of Point3d
# ---------- imghue: Python ----------
"""
Calculates the luminance values of an image at specified points.

Inputs:
    image_path: String (item access, string)
    points: List of Points (list access, pt)

Outputs:
    values: List of Numbers (The luminance values at each point)
"""

try:
    ghenv.Component.Name = "ImageHue"
    ghenv.Component.NickName = "ImgHue"
    ghenv.Component.Description = "Calculates the luminance values of an image at specified points."
except NameError:
    pass

import System.Drawing as sd

def get_image_values(img_path, pts):
    if not img_path or not pts:
        return []
        
    try:
        bmp = sd.Bitmap(img_path)
    except Exception as e:
        print("Error loading image: " + str(e))
        return []
        
    w = bmp.Width - 1
    h = bmp.Height - 1
    
    min_x = min([p.X for p in pts])
    max_x = max([p.X for p in pts])
    min_y = min([p.Y for p in pts])
    max_y = max([p.Y for p in pts])
    
    range_x = max_x - min_x
    range_y = max_y - min_y
    
    if range_x == 0: range_x = 1.0
    if range_y == 0: range_y = 1.0

    out_values = []
    
    for pt in pts:
        norm_x = (pt.X - min_x) / range_x
        norm_y = (pt.Y - min_y) / range_y
        
        px = int(norm_x * w)
        py = int((1.0 - norm_y) * h)
        
        px = max(0, min(px, w))
        py = max(0, min(py, h))
        
        color = bmp.GetPixel(px, py)
        
        luminance = (0.299 * color.R + 0.587 * color.G + 0.114 * color.B) / 255.0
        out_values.append(luminance)
        
    bmp.Dispose() 
    
    return out_values

if 'image_path' in globals() and 'points' in globals():
    values = get_image_values(image_path, points)
# ---------- end imghue ----------
panel_3 = Panel(valremap)
panel_4 = Panel(randvalgen)
panel_5 = Panel(stepround)
panel_6 = Panel(imghue)
number_slider_5 = Slider(0, range=0..1)
number_slider_6 = Slider(1, range=0..1)
pattsel = PatternSelector(index=Slider(53, range=0..100))  # -> values; inputs index: Int32
# ---------- pattsel: Python ----------
"""
Selects a 7-bit combination pattern based on an index.

Inputs:
    index: Number (item access, int)

Outputs:
    values: List of Numbers (The selected 7-bit combination pattern)
"""

try:
    ghenv.Component.Name = "PatternSelector"
    ghenv.Component.NickName = "PattSel"
    ghenv.Component.Description = "Selects a 7-bit combination pattern based on an index."
except NameError:
    pass

import itertools

all_combinations = list(itertools.product([0, 1], repeat=7))
valid_combinations = [comb for comb in all_combinations if sum(comb) >= 2]

if 'index' in globals() and index is not None:
    safe_index = max(0, min(int(index), len(valid_combinations) - 1))
    values = list(valid_combinations[safe_index])
else:
    values = []
# ---------- end pattsel ----------
crv_10 = Curve([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])
pattselutil = PatternSelectionUtility(
    use_centroid=number_slider_6,
    use_outer_mid=number_slider_5,
    use_outer_vert=number_slider_6,
    use_outer_eval=number_slider_5,
    use_inner_mid=number_slider_5,
    use_inner_vert=number_slider_6,
    use_inner_eval=number_slider_5)  # -> point_toggle; inputs use_centroid: Boolean, use_outer_mid: Boolean, use_outer_vert: Boolean, use_outer_eval: Boolean, use_inner_mid: Boolean, use_inner_vert: Boolean, use_inner_eval: Boolean
# ---------- pattselutil: Python ----------
"""
Utility to generate a 7-item boolean list for the PattGen component by allowing users to toggle individual point generators.

Inputs:
    use_centroid: Boolean (Toggle for Cell Centroid - Point 1)
    use_outer_mid: Boolean (Toggle for Outer Cell Midpoints - Point 2)
    use_outer_vert: Boolean (Toggle for Outer Cell Vertices - Point 3)
    use_outer_eval: Boolean (Toggle for Outer Cell Evaluated Points - Point 4)
    use_inner_mid: Boolean (Toggle for Inner Cell Midpoints - Point 5)
    use_inner_vert: Boolean (Toggle for Inner Cell Vertices - Point 6)
    use_inner_eval: Boolean (Toggle for Inner Cell Evaluated Points - Point 7)

Outputs:
    point_toggle: List of Booleans (A 7-item list to plug directly into the PattGen component)
"""

try:
    ghenv.Component.Name = "PatternSelectionUtility"
    ghenv.Component.NickName = "PattSelUtil"
    ghenv.Component.Description = "Utility to generate a 7-item boolean toggle list for the PattGen component by allowing users to toggle individual point generators."
except NameError:
    pass

# Helper function to safely cast inputs to boolean, defaulting to False (0) if no input is wired
def safe_bool(val):
    if val is None:
        return False
    return bool(val)

# Process all 7 inputs
p1 = safe_bool(use_centroid)
p2 = safe_bool(use_outer_mid)
p3 = safe_bool(use_outer_vert)
p4 = safe_bool(use_outer_eval)
p5 = safe_bool(use_inner_mid)
p6 = safe_bool(use_inner_vert)
p7 = safe_bool(use_inner_eval)

# Combine into the ordered 7-item list required by PattGen
point_toggle = [p1, p2, p3, p4, p5, p6, p7]
# ---------- end pattselutil ----------
crv_11 = Curve([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])
crv_12 = Curve(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)
pattgen = PatternGenerator(
    grid_cells=crv_10,
    inner_scale=Slider(0.66, range=0..1),
    eval_outer=Slider(0.66, range=0..1),
    eval_inner=Slider(0.54, range=0..1),
    point_toggle=pattsel)  # -> pattern_curves; inputs grid_cells: list of Curve, inner_scale: Double, eval_outer: Double, eval_inner: Double, point_toggle: list of Boolean
# ---------- pattgen: Python ----------
"""
Generates a custom Voronoi pattern within grid cells based on scaled inner boundaries and evaluated curve points.
HIGH PERFORMANCE: Utilizes System.Threading.Tasks for concurrent multi-core processing.

Inputs:
    grid_cells: List of Curves (Base grid cells to reference as boundaries)
    inner_scale: Float (Scale factor between 0.0 and 1.0 for the inner cell)
    eval_outer: Float (Evaluation parameter between 0.0 and 1.0 for outer cell edges)
    eval_inner: Float (Evaluation parameter between 0.0 and 1.0 for inner cell edges)
    point_toggle: List of Booleans (7-item list of 0s and 1s activating specific generator points)

Outputs:
    pattern_curves: DataTree of Curves (The final generated Voronoi pattern curves, organized by grid cell)
"""

try:
    ghenv.Component.Name = "PatternGenerator"
    ghenv.Component.NickName = "PattGen"
    ghenv.Component.Description = "Generates a custom Voronoi pattern utilizing parallel multi-threading for maximum speed."
except NameError:
    pass

import Rhino.Geometry as rg
import ghpythonlib.components as ghcomp
import ghpythonlib.treehelpers as th
import System.Threading.Tasks as tasks # The key to multi-threading

def generate_points(cell, inner_scale, eval_outer, eval_inner, toggle):
    pts = []
    
    amp = rg.AreaMassProperties.Compute(cell)
    if not amp: return []
    centroid = amp.Centroid
    
    if toggle[0]: pts.append(centroid)
        
    xform = rg.Transform.Scale(centroid, inner_scale)
    inner_cell = cell.DuplicateCurve()
    inner_cell.Transform(xform)
    
    outer_segments = cell.DuplicateSegments()
    inner_segments = inner_cell.DuplicateSegments()
    
    if outer_segments:
        if toggle[1]:
            for seg in outer_segments: pts.append(seg.PointAtNormalizedLength(0.5))
        if toggle[2]:
            for seg in outer_segments: pts.append(seg.PointAtStart)
        if toggle[3]:
            for seg in outer_segments: pts.append(seg.PointAtNormalizedLength(eval_outer))
                
    if inner_segments:
        if toggle[4]:
            for seg in inner_segments: pts.append(seg.PointAtNormalizedLength(0.5))
        if toggle[5]:
            for seg in inner_segments: pts.append(seg.PointAtStart)
        if toggle[6]:
            for seg in inner_segments: pts.append(seg.PointAtNormalizedLength(eval_inner))
                
    return pts

# --- MAIN EXECUTION ---
tolerance = 0.001 

# Pre-allocate a list of empty lists the exact size of grid_cells to avoid memory reallocation
nested_curves = [[] for _ in range(len(grid_cells))] if grid_cells else []

def process_cell(i):
    """ This function will be executed simultaneously across all your CPU cores """
    cell = grid_cells[i]
    if not isinstance(cell, rg.Curve) or not cell.IsClosed:
        return
        
    success, plane = cell.TryGetPlane()
    if not success: plane = rg.Plane.WorldXY
        
    # Generate and cull points
    cell_points = generate_points(cell, inner_scale, eval_outer, eval_inner, point_toggle)
    if not cell_points: return
    
    clean_points = rg.Point3d.CullDuplicates(cell_points, tolerance) if len(cell_points) > 1 else cell_points
        
    if clean_points and len(clean_points) >= 2:
        
        # Bounding box logic
        bbox = cell.GetBoundingBox(True)
        bbox.Inflate(0.5) 
        
        c1 = rg.Point3d(bbox.Min.X, bbox.Min.Y, 0)
        c2 = rg.Point3d(bbox.Max.X, bbox.Min.Y, 0)
        c3 = rg.Point3d(bbox.Max.X, bbox.Max.Y, 0)
        c4 = rg.Point3d(bbox.Min.X, bbox.Max.Y, 0)
        bbox_crv = rg.Polyline([c1, c2, c3, c4, c1]).ToNurbsCurve()
        
        # Voronoi generation
        v_cells_raw = ghcomp.Voronoi(clean_points, boundary=bbox_crv)
        if isinstance(v_cells_raw, rg.Curve): v_cells = [v_cells_raw]
        elif v_cells_raw: v_cells = list(v_cells_raw)
        else: return
            
        trimmed_cells = []
        for v_c in v_cells:
            if not v_c.IsClosed: continue 
            
            # Topological math check (much faster than booleans)
            rel = rg.Curve.PlanarClosedCurveRelationship(cell, v_c, plane, tolerance)
            
            if rel == rg.RegionContainment.BInsideA:
                trimmed_cells.append(v_c)
                
            elif rel == rg.RegionContainment.MutualIntersection or rel == rg.RegionContainment.AInsideB:
                # Only boolean what absolutely must be booleaned
                intersections = rg.Curve.CreateBooleanIntersection(v_c, cell, tolerance)
                if intersections:
                    for int_crv in intersections:
                        if int_crv.IsClosed:
                            trimmed_cells.append(int_crv)
                            
        # Safely insert the final trimmed cells into their exact index position
        nested_curves[i] = trimmed_cells

# Initialize the parallel processing loop
if grid_cells and len(point_toggle) == 7:
    # tasks.Parallel.For takes a start index, end index, and the function to run concurrently
    tasks.Parallel.For(0, len(grid_cells), process_cell)

# Convert the cleanly ordered nested list into a Grasshopper DataTree
pattern_curves = th.list_to_tree(nested_curves)
# ---------- end pattgen ----------
vorgrid = GridVoronoi(
    grid_cells=crv_11,
    boundary=crv_12,
    min_eval=Slider(0.25, range=0..1),
    max_eval=Slider(0.75, range=0..1),
    seed=Slider(3, range=0..10))  # -> voronoi_cells; inputs grid_cells: list of Curve, boundary: Curve, min_eval: Double, max_eval: Double, seed: Int32
# ---------- vorgrid: Python ----------
"""
Utility to generate Voronoi cells from points evaluated within a list of grid cells.

Inputs:
    grid_cells: List of Geometry (Surfaces, Breps, or Closed Curves)
    boundary: Curve (A single boundary curve to clip the entire Voronoi pattern)
    min_eval: Float (Minimum value to evaluate reparameterized surface, between 0 and 1)
    max_eval: Float (Maximum value to evaluate reparameterized surface, between 0 and 1)
    seed: Integer (Seed for random value generation)

Outputs:
    voronoi_cells: List of Curves (The generated Voronoi cells based on the evaluated points)
"""

try:
    ghenv.Component.Name = "GridVoronoi"
    ghenv.Component.NickName = "VorGrid"
    ghenv.Component.Description = "Generates Voronoi cells by randomly evaluating normalized coordinates within a set of grid surfaces."
except NameError:
    pass

import Rhino.Geometry as rg
import ghpythonlib.components as ghcomp
import random

# Initialize output
voronoi_cells = []

# Ensure inputs exist
if grid_cells and boundary and min_eval is not None and max_eval is not None and seed is not None:
    
    # Clamp eval values between 0 and 1
    min_eval = max(0.0, min(1.0, min_eval))
    max_eval = max(0.0, min(1.0, max_eval))
    
    random.seed(seed)
    num_cells = len(grid_cells)
    
    # Generate random evaluation values
    random_vals = [random.uniform(min_eval, max_eval) for _ in range(num_cells * 2)]
    u_vals = random_vals[:num_cells]
    v_vals = random_vals[num_cells:]
    
    evaluated_points = []
    
    for i, cell in enumerate(grid_cells):
        srf = None
        
        # Unwrap Grasshopper data types
        geom = cell.Value if hasattr(cell, 'Value') else cell
            
        # 1. ROBUST GEOMETRY HANDLING: Automatically accept Surfaces, Breps, or Curves
        if isinstance(geom, rg.Brep) and geom.Faces.Count > 0:
            srf = geom.Faces[0]
        elif isinstance(geom, rg.Surface):
            srf = geom
        elif isinstance(geom, rg.Curve) and geom.IsClosed and geom.IsPlanar():
            # If a curve (like your hexgrid) is passed, make it a temporary surface
            breps = rg.Brep.CreatePlanarBreps(geom, 0.001)
            if breps and len(breps) > 0:
                srf = breps[0].Faces[0]
                
        # Evaluate if a surface was successfully found or created
        if srf:
            u_domain = srf.Domain(0)
            v_domain = srf.Domain(1)
            
            u_mapped = u_domain.Min + (u_vals[i] * (u_domain.Max - u_domain.Min))
            v_mapped = v_domain.Min + (v_vals[i] * (v_domain.Max - v_domain.Min))
            
            pt = srf.PointAt(u_mapped, v_mapped)
            evaluated_points.append(pt)
            
    # Generate Voronoi if points exist
    if evaluated_points:
        # 2. ROBUST BOUNDARY HANDLING: Force boundary into a Rectangle3d
        bnd_geom = boundary.Value if hasattr(boundary, 'Value') else boundary
        bnd_box = bnd_geom.GetBoundingBox(True)
        
        x_interval = rg.Interval(bnd_box.Min.X, bnd_box.Max.X)
        y_interval = rg.Interval(bnd_box.Min.Y, bnd_box.Max.Y)
        bnd_rect = rg.Rectangle3d(rg.Plane.WorldXY, x_interval, y_interval)
        
        # Generate Voronoi using positional arguments to prevent kwarg misfires
        v_cells = ghcomp.Voronoi(evaluated_points, None, bnd_rect)
        
        if v_cells:
            voronoi_cells = v_cells
# ---------- end vorgrid ----------
crv_13 = Curve([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])
panel_7 = Panel(pattselutil)
crv_14 = Curve(pattgen)
pattgen_2 = PatternGenerator(
    grid_cells=crv_13,
    inner_scale=Slider(0.66, range=0..1),
    eval_outer=Slider(0.66, range=0..1),
    eval_inner=Slider(0.54, range=0..1),
    point_toggle=pattselutil)  # -> pattern_curves; inputs grid_cells: list of Curve, inner_scale: Double, eval_outer: Double, eval_inner: Double, point_toggle: list of Boolean; same code as pattgen
crv_15 = Curve(vorgrid)
crv_16 = Curve(pattgen_2)

clustercrack = ClusterCrack()  # -> Report; inputs ClusterName: String, NewPassword: String, Run: Boolean
# ---------- clustercrack: C# ----------
using System;
using System.Collections;
using System.Collections.Generic;

using Rhino;
using Rhino.Geometry;

using Grasshopper;
using Grasshopper.Kernel;
using Grasshopper.Kernel.Data;
using Grasshopper.Kernel.Types;

/// <summary>
/// This class will be instantiated on demand by the Script component.
/// </summary>
public class Script_Instance : GH_ScriptInstance
{
  /// <summary>Print a String to the [Out] Parameter of the Script component.</summary>
  /// <param name="text">String to print.</param>
  private void Print(string text) { /* Implementation hidden. */ }
  /// <summary>Print a formatted String to the [Out] Parameter of the Script component.</summary>
  /// <param name="format">String format.</param>
  /// <param name="args">Formatting parameters.</param>
  private void Print(string format, params object[] args) { /* Implementation hidden. */ }
  /// <summary>Print useful information about an object instance to the [Out] Parameter of the Script component. </summary>
  /// <param name="obj">Object instance to parse.</param>
  private void Reflect(object obj) { /* Implementation hidden. */ }
  /// <summary>Print the signatures of all the overloads of a specific method to the [Out] Parameter of the Script component. </summary>
  /// <param name="obj">Object instance to parse.</param>
  private void Reflect(object obj, string method_name) { /* Implementation hidden. */ }

  /// <summary>Gets the current Rhino document.</summary>
  private readonly RhinoDoc RhinoDocument;
  /// <summary>Gets the Grasshopper document that owns this script.</summary>
  private readonly GH_Document GrasshopperDocument;
  /// <summary>Gets the Grasshopper script component that owns this script.</summary>
  private readonly IGH_Component Component;
  /// <summary>
  /// Gets the current iteration count. The first call to RunScript() is associated with Iteration==0.
  /// Any subsequent call within the same solution will increment the Iteration count.
  /// </summary>
  private readonly int Iteration;

  /// <summary>
  /// This procedure contains the user code. Input parameters are provided as regular arguments,
  /// Output parameters as ref arguments. You don't have to assign output parameters,
  /// they will have a default value.
  /// </summary>
  private void RunScript(
		string ClusterName,
		string NewPassword,
		bool Run,
		ref object Report)
  {
    // --- begin body ---
    if (!Run)
    {
      Report = "Idle. Toggle Run = true to execute.";
      return;
    }
    if (string.IsNullOrWhiteSpace(NewPassword))
    {
      Report = "NewPassword is empty. Aborting.";
      return;
    }

    try
    {
      Grasshopper.Kernel.GH_Document doc = GrasshopperDocument;
      if (doc == null) { Report = "No active Grasshopper document."; return; }

      // 1) Locate target cluster by NickName or by selection
      Grasshopper.Kernel.Special.GH_Cluster target = null;

      if (!string.IsNullOrWhiteSpace(ClusterName))
      {
        foreach (var obj in doc.Objects)
        {
          var cl = obj as Grasshopper.Kernel.Special.GH_Cluster;
          if (cl != null && string.Equals(cl.NickName, ClusterName, System.StringComparison.OrdinalIgnoreCase))
          { target = cl; break; }
        }
      }
      if (target == null)
      {
        foreach (var obj in doc.Objects)
        {
          var cl = obj as Grasshopper.Kernel.Special.GH_Cluster;
          if (cl != null && cl.Attributes.Selected)
          { target = cl; break; }
        }
      }
      if (target == null)
      {
        Report = "No GH_Cluster found. Set ClusterName or select a cluster and re-run.";
        return;
      }

      // 2) Reflect the private password field
      System.Type tCluster = typeof(Grasshopper.Kernel.Special.GH_Cluster);
      var pwField = tCluster.GetField(
        "m_password",
        System.Reflection.BindingFlags.Instance | System.Reflection.BindingFlags.NonPublic
        );

      if (pwField == null)
      {
        foreach (var f in tCluster.GetFields(System.Reflection.BindingFlags.Instance | System.Reflection.BindingFlags.NonPublic))
        {
          if (f.FieldType == typeof(byte[]) && f.Name.ToLowerInvariant().Contains("pass"))
          { pwField = f; break; }
        }
      }
      if (pwField == null)
      {
        Report = "Could not locate the private password field on GH_Cluster (API change?).";
        return;
      }

      // 3) Synthesize password bytes via a temporary cluster
      byte[] newPwBytes = null;
      try
      {
        var temp = System.Activator.CreateInstance(tCluster) as Grasshopper.Kernel.Special.GH_Cluster;
        var assign = tCluster.GetMethod(
          "AssignNewPassword",
          System.Reflection.BindingFlags.Instance | System.Reflection.BindingFlags.Public | System.Reflection.BindingFlags.NonPublic,
          null,
          new System.Type[] { typeof(string), typeof(string) },
          null);

        if (assign != null)
        {
          // On a fresh cluster, oldPw can be null/empty
          assign.Invoke(temp, new object[] { null, NewPassword });
          newPwBytes = (byte[]) pwField.GetValue(temp);
        }
      }
      catch { newPwBytes = null; }

      if (newPwBytes == null || newPwBytes.Length == 0)
      {
        Report = "Could not synthesize password bytes (AssignNewPassword not available on this build).";
        return;
      }

      // 4) Write bytes into the target cluster and expire
      pwField.SetValue(target, newPwBytes);
      target.ExpireSolution(true);
      doc.ExpireSolution();

      Report = "Success. The target cluster now accepts the new password.";
    }
    catch (System.Reflection.TargetInvocationException tie)
    {
      Report = "Invocation error: " + (tie.InnerException != null ? tie.InnerException.Message : tie.Message);
    }
    catch (System.Exception ex)
    {
      Report = "Error: " + ex.Message;
    }
    // --- end body ---
    // --- end body ---

  }

  // <Custom additional code> 

  // </Custom additional code> 
}
# ---------- end clustercrack ----------
strsort = StringSort()  # -> sorted_values; inputs values: String
# ---------- strsort: Python ----------
"""
Sorts a list of strings using Natural Sorting (e.g., 2 comes before 10).

Inputs:
    values: List of Strings (list access, str)

Outputs:
    sorted_values: List of Strings (The naturally sorted list)
"""

try:
    ghenv.Component.Name = "StringSort"
    ghenv.Component.NickName = "StrSort"
    ghenv.Component.Description = "Sorts a list of strings using Natural Sorting."
except NameError:
    pass

import re

def natural_sort_key(s):
    return [int(text) if text.isdigit() else text.lower() for text in re.split(r'(\d+)', str(s))]

if 'values' in globals() and values:
    sorted_values = sorted(values, key=natural_sort_key)
else:
    sorted_values = []
# ---------- end strsort ----------
datagate = DataGate()  # -> out_data; inputs data: tree, toggle: Boolean
# ---------- datagate: Python ----------
"""
Utility to control the flow of data. Acts as a gate that can pass or block a data stream based on a boolean toggle.

Inputs:
    toggle: Boolean (Set to True to pass data, False to block data)
    data: Data/DataTree (The input data stream to be controlled)

Outputs:
    out_data: Data/DataTree (Outputs the original data if toggle is True, or an empty DataTree if False)
"""

try:
    ghenv.Component.Name = "DataGate"
    ghenv.Component.NickName = "DataGate"
    ghenv.Component.Description = "Acts as a gate to either pass data through or block it completely by outputting an empty DataTree."
except NameError:
    pass

import Grasshopper as gh

# Check if the toggle is set to True
if toggle:
    # Pass the data through exactly as it is
    out_data = data
else:
    # Output an empty DataTree to block the stream completely
    out_data = gh.DataTree[object]()
# ---------- end datagate ----------

crv_17 = Curve(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)
crv_18 = Curve(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)
frmtab = FrameTabSystem(
    boundary=crv_18,
    tab_height=Slider(2, range=0..10),
    tab_width=Slider(0.168, range=0..1),
    tab_space_x=Slider(0.472, range=0..1),
    tab_space_y=Slider(11, range=0..100))  # -> frame_face, tabs; inputs boundary: Curve
# ---------- frmtab: Python ----------
"""
Creates parametric tab perforations within a frame boundary for an aluminum panel system.

Inputs:
    boundary: Geometry (item access, crv)
    tab_height: Number (item access, float)
    tab_width: Number (item access, float)
    tab_space_x: Number (item access, float)
    tab_space_y: Number (item access, float)

Outputs:
    frame_face: Curve (The original rectangular frame face)
    tabs: List of Curves (The curves representing the newly created tabs/openings)
"""

import Rhino.Geometry as rg

try:
    ghenv.Component.Name = "FrameTabSystem"
    ghenv.Component.NickName = "FrmTab"
    ghenv.Component.Description = "Creates parametric tab perforations within a frame boundary for an aluminum panel system."
except NameError:
    pass

def create_frame_tabs(boundary, tab_height, tab_width, tab_space_x, tab_space_y):
    # Data validation
    if not boundary or tab_height is None or tab_width is None or tab_space_x is None or tab_space_y is None:
        return None, []
        
    # Attempt to get the local plane of the boundary curve to ensure it works in 3D space
    rc, plane = boundary.TryGetPlane()
    if not rc:
        plane = rg.Plane.WorldXY
        
    # Get bounding box aligned to the valid plane
    bbox = boundary.GetBoundingBox(plane)
    
    min_x = bbox.Min.X
    max_x = bbox.Max.X
    min_y = bbox.Min.Y
    max_y = bbox.Max.Y
    
    height = max_y - min_y
    mid_x = min_x + ((max_x - min_x) / 2.0)
    
    # 1. Frame Face Output
    frame_face = boundary
    
    # 2. Tabs Output
    tabs = []
    
    # Determine the number of tab sets on the Y axis
    num_tabs = max(1, int(round(height / tab_space_y)))
    
    mid_y = min_y + (height / 2.0)
    y_centers = []
    
    # Calculate tab centerpoints expanding outward from the middle
    if num_tabs % 2 == 1:
        # Odd number of tabs (1 center tab + mirrored pairs)
        half_count = num_tabs // 2
        for i in range(-half_count, half_count + 1):
            y_centers.append(mid_y + i * tab_space_y)
    else:
        # Even number of tabs (mirrored pairs offset from center)
        half_count = num_tabs // 2
        for i in range(1, half_count + 1):
            y_centers.append(mid_y + (i - 0.5) * tab_space_y)
            y_centers.append(mid_y - (i - 0.5) * tab_space_y)
            
    # Calculate the X centers for the two perforations based on spacing from the face middle
    left_x_center = mid_x - (tab_space_x / 2.0)
    right_x_center = mid_x + (tab_space_x / 2.0)
    
    # Generate the 2 tab openings at each calculated Y height
    for cy in y_centers:
        tab_y_int = rg.Interval(cy - tab_height / 2.0, cy + tab_height / 2.0)
        
        # Left Tab Opening
        left_tab_x = rg.Interval(left_x_center - tab_width / 2.0, left_x_center + tab_width / 2.0)
        left_tab = rg.Rectangle3d(plane, left_tab_x, tab_y_int).ToNurbsCurve()
        tabs.append(left_tab)
        
        # Right Tab Opening
        right_tab_x = rg.Interval(right_x_center - tab_width / 2.0, right_x_center + tab_width / 2.0)
        right_tab = rg.Rectangle3d(plane, right_tab_x, tab_y_int).ToNurbsCurve()
        tabs.append(right_tab)
        
    return frame_face, tabs

frame_face, tabs = create_frame_tabs(boundary, tab_height, tab_width, tab_space_x, tab_space_y)
# ---------- end frmtab ----------
pantab = PanelTabSystem(
    boundary=crv_17,
    fold_width=Slider(2, range=0..10),
    tab_width=Slider(2, range=0..10),
    tab_height=Slider(4, range=0..10),
    tab_spacing=Slider(20, range=0..100))  # -> panel_face, fold, tabs; inputs boundary: Curve
# ---------- pantab: Python ----------
"""
Creates fold areas and tabs for an aluminum panel system based on a face boundary.

Inputs:
    boundary: Geometry (item access, crv)
    fold_width: Number (item access, float)
    tab_width: Number (item access, float)
    tab_height: Number (item access, float)
    tab_spacing: Number (item access, float)

Outputs:
    panel_face: Curve (The original panel face rectangle)
    fold: List of Curves (The left and right fold areas)
    tabs: List of Curves (The tab geometry on the outside of the fold areas)
"""

import Rhino.Geometry as rg
import math

try:
    ghenv.Component.Name = "PanelTabSystem"
    ghenv.Component.NickName = "PanTab"
    ghenv.Component.Description = "Creates fold areas and tabs for an aluminum panel system based on a face boundary."
except NameError:
    pass

def create_panel_system(boundary, fold_width, tab_width, tab_height, tab_spacing):
    # Data validation
    if not boundary or fold_width is None or tab_width is None or tab_height is None or tab_spacing is None:
        return None, [], []
        
    # Attempt to get the local plane of the boundary curve to ensure it works in 3D space
    rc, plane = boundary.TryGetPlane()
    if not rc:
        plane = rg.Plane.WorldXY
        
    # Get bounding box aligned to the valid plane
    bbox = boundary.GetBoundingBox(plane)
    
    min_x = bbox.Min.X
    max_x = bbox.Max.X
    min_y = bbox.Min.Y
    max_y = bbox.Max.Y
    
    height = max_y - min_y
    
    # 1. Panel Face Output
    panel_face = boundary
    
    # 2. Fold Areas Output
    fold = []
    
    # Left Fold
    left_fold_x = rg.Interval(min_x - fold_width, min_x)
    y_int = rg.Interval(min_y, max_y)
    left_fold = rg.Rectangle3d(plane, left_fold_x, y_int).ToNurbsCurve()
    fold.append(left_fold)
    
    # Right Fold
    right_fold_x = rg.Interval(max_x, max_x + fold_width)
    right_fold = rg.Rectangle3d(plane, right_fold_x, y_int).ToNurbsCurve()
    fold.append(right_fold)
    
    # 3. Tabs Output
    tabs = []
    
    # Determine the number of tabs based on spacing and height
    num_tabs = max(1, int(round(height / tab_spacing)))
    
    mid_y = min_y + (height / 2.0)
    centers = []
    
    # Calculate tab centerpoints expanding outward from the middle
    if num_tabs % 2 == 1:
        # Odd number of tabs (1 center tab + mirrored pairs)
        half_count = num_tabs // 2
        for i in range(-half_count, half_count + 1):
            centers.append(mid_y + i * tab_spacing)
    else:
        # Even number of tabs (mirrored pairs offset from center)
        half_count = num_tabs // 2
        for i in range(1, half_count + 1):
            centers.append(mid_y + (i - 0.5) * tab_spacing)
            centers.append(mid_y - (i - 0.5) * tab_spacing)
            
    # Generate left and right tab curves at each center height
    for cy in centers:
        tab_y_int = rg.Interval(cy - tab_height / 2.0, cy + tab_height / 2.0)
        
        # Left Tab
        left_tab_x = rg.Interval(min_x - fold_width - tab_width, min_x - fold_width)
        left_tab = rg.Rectangle3d(plane, left_tab_x, tab_y_int).ToNurbsCurve()
        tabs.append(left_tab)
        
        # Right Tab
        right_tab_x = rg.Interval(max_x + fold_width, max_x + fold_width + tab_width)
        right_tab = rg.Rectangle3d(plane, right_tab_x, tab_y_int).ToNurbsCurve()
        tabs.append(right_tab)
        
    return panel_face, fold, tabs

panel_face, fold, tabs = create_panel_system(boundary, fold_width, tab_width, tab_height, tab_spacing)
# ---------- end pantab ----------
crv_19 = Curve(frmtab.frame_face)
crv_20 = Curve(frmtab.tabs)
crv_21 = Curve(pantab.tabs)
crv_22 = Curve(pantab.panel_face)
crv_23 = Curve(pantab.fold)

geobnd2d = GeometryBoundary2D()  # -> bnd_rect, x, y; inputs geo: GeometryBase, plane: Plane
# ---------- geobnd2d: Python ----------
"""
Draws a boundary rectangle around a geometry based on a user-defined plane.

Inputs:
    geo: Geometry (item access, geo)
    plane: Plane (item access, plane)

Outputs:
    bnd_rect: Curve (The bounding rectangle aligned to the input plane)
    x: Number (Dimension in the first axis of the plane)
    y: Number (Dimension in the second axis of the plane)
"""

try:
    ghenv.Component.Name = "GeometryBoundary2D"
    ghenv.Component.NickName = "GeoBnd2D"
    ghenv.Component.Description = "Draws a boundary rectangle around a geometry based on a user-defined plane."
except NameError:
    pass

import Rhino.Geometry as rg

def create_oriented_boundary(geometry, base_plane):
    """
    Calculates the bounding rectangle of a geometry aligned to a specific plane.
    """
    # Get the bounding box of the geometry oriented to the user-defined plane
    bbox = geometry.GetBoundingBox(base_plane)
    
    if not bbox.IsValid:
        return None, None, None
        
    # Extract the X and Y domains (intervals) from the local bounding box coordinates
    interval_x = rg.Interval(bbox.Min.X, bbox.Max.X)
    interval_y = rg.Interval(bbox.Min.Y, bbox.Max.Y)
    
    # Construct the rectangle on the given plane using the intervals
    rect = rg.Rectangle3d(base_plane, interval_x, interval_y)
    
    # Extract dimensions
    dim_x = interval_x.Length
    dim_y = interval_y.Length
    
    return rect.ToNurbsCurve(), dim_x, dim_y

# Initialize outputs
bnd_rect = None
x = None
y = None

# Execute if inputs are provided
if geo and plane:
    bnd_rect, x, y = create_oriented_boundary(geo, plane)
# ---------- end geobnd2d ----------
geobnd3d = GeometryBoundary3D()  # -> bnd_box, x, y, z; inputs geo: GeometryBase
# ---------- geobnd3d: Python ----------
"""
Draws a boundary box around a geometry.

Inputs:
    geo: Geometry (item access, geo)

Outputs:
    bnd_box: Box (The 3D bounding box of the original geometry)
    x: Number (Dimension in the first axis)
    y: Number (Dimension in the second axis)
    z: Number (Dimension in the third axis)
"""

try:
    ghenv.Component.Name = "GeometryBoundary3D"
    ghenv.Component.NickName = "GeoBnd3D"
    ghenv.Component.Description = "Draws a boundary box around a geometry."
except NameError:
    pass

import Rhino.Geometry as rg

def create_bounding_box(geometry):
    """
    Calculates the world-aligned 3D bounding box of a geometry.
    """
    # Get the world-aligned bounding box of the geometry
    bbox = geometry.GetBoundingBox(True)
    
    if not bbox.IsValid:
        return None, None, None, None
        
    # Convert BoundingBox to a Box geometry 
    box = rg.Box(bbox)
    
    # Extract dimensions using the Min and Max points
    dim_x = bbox.Max.X - bbox.Min.X
    dim_y = bbox.Max.Y - bbox.Min.Y
    dim_z = bbox.Max.Z - bbox.Min.Z
    
    return box, dim_x, dim_y, dim_z

# Initialize outputs
bnd_box = None
x = None
y = None
z = None

# Execute if input is provided
if geo:
    bnd_box, x, y, z = create_bounding_box(geo)
# ---------- end geobnd3d ----------
